# Grasshopper definition solarProxy.gh (Grasshopper 1.0.7)

# ----
# Inputs
inputs_panel = Panel("")
# XIM Standards
data = Data(True)

where_do_you_want_to_analyze = ValueList({"Facade": 0, "Roof": 1, "Facade and Roof": 2}, selected="Facade and Roof")
tap_new_folder_path = Panel("C:\Users\hz2690\Google Drive\XIM\2020-12-17\norm")
srf_subdivide_resolution = Panel("50")
brep_massing_to_analyze = Brep([<brep referenced from the Rhino model> x2])
file_path_weather_file_epw = FilePath("C:\Users\hz2690\Google Drive\XIM\02_class_tutorial\6.environmental_simulation\1.USA_NY_New.York-Central.Park.725033_TMY3\USA_NY_New.York-Central.Park.725033_TMY3.epw")
new_epw_file = Button()
brep_context = Brep([<brep referenced from the Rhino model> x7])

# ----
# Ouputs
data_2 = Data(True)

# ----
# Note
# Actions
# DO NOT CHANGE
# Previews
note_panel = Panel("")

# ----
# Solar Energy Proxy
cluster = Cluster_7(
    data_weather_file=file_path_weather_file_epw,
    data_new_folder_path=tap_new_folder_path,
    bool=new_epw_file,
    brep_context=brep_context,
    brep_massing_to_analyze=brep_massing_to_analyze,
    num_analysis_resolution=srf_subdivide_resolution,
    num_surface_choice=where_do_you_want_to_analyze)  # -> srf_analysis_surfaces_4, num_upper_limit_2, num_a_proxy_of_annual_solar_radiation_2, num_annual_energy_generation_simulation_2, num_proxy_of_construction_expexse_buildi_2
num_proxy_of_construction_expexse_buildi = Number(cluster.num_proxy_of_construction_expexse_buildi_2)  # "Num : proxy of construction expexse - Building efficiency"

num_a_proxy_of_annual_solar_radiation = Number(cluster.num_a_proxy_of_annual_solar_radiation_2)
num_upper_limit = Number(cluster.num_upper_limit_2)
srf_analysis_surfaces = Surface(cluster.srf_analysis_surfaces_4)

num_annual_energy_generation = Number(cluster.num_annual_energy_generation_simulation_2)
num_proxy_of_construction_expexse_buildi_2 = Panel(num_proxy_of_construction_expexse_buildi)  # "Num : proxy of construction expexse - Building efficiency"
kwh = Panel(num_annual_energy_generation)
gradient = Gradient(
    LowerLimit="0",
    UpperLimit=num_upper_limit,
    Parameter=num_a_proxy_of_annual_solar_radiation,
    stops=[0: RGB(0, 128, 0), 0.5: RGB(255, 255, 0), 1: RGB(255, 0, 0)])
mcol = MeshColours(Mesh=srf_analysis_surfaces, Colours=gradient)

# ==== cluster Cluster_7
brep_massing_to_analyze = ClusterInput()
num_surface_choice = ClusterInput()
num_analysis_resolution = ClusterInput()
data_weather_file = ClusterInput()
bool = ClusterInput()
data_new_folder_path = ClusterInput()
brep_context = ClusterInput()
data_weather_file_2 = Data(data_weather_file)
num_analysis_resolution_2 = Number(num_analysis_resolution)
brep_context_2 = Brep(brep_context)
num_surface_choice_2 = Number(num_surface_choice)
brep_massing_to_analyze_2 = Brep(brep_massing_to_analyze)
data_new_folder_path_2 = Data(data_new_folder_path)
bool_2 = Boolean(bool)
cluster = Cluster_5(folder_path=data_new_folder_path_2, epw=data_weather_file_2, run=bool_2)
num_analysis_resolution_3 = Number(num_analysis_resolution_2)
int_acceptable_pv_effiecency_per_sq_ft = Integer(cluster)
brep_design = Brep(brep_massing_to_analyze_2)
geo_context = Geometry(brep_context_2)
mesh = Mesh(geo_context)
cluster_2 = Cluster_4(brep_design=brep_design, num_analysis_resolution=num_analysis_resolution_3)  # -> srf_analysis_surfaces_facade_2, srf_analysis_surfaces_roof_2
cluster_3 = Cluster_6(brep_design=brep_design, num_analysis_resolution=num_analysis_resolution_3)  # -> srf_analysis_surfaces_roof_2, srf_analysis_surfaces_facade_2
mjoin = MeshJoin(Meshes=mesh)
merge = Merge(Data1=flatten(mjoin), Data2=flatten(brep_design))
merge_2 = Merge(Data1=flatten(geo_context), Data2=flatten(brep_design))
mjoin_2 = MeshJoin(Meshes=merge)
merge_3 = Merge(Data1=cluster_3.srf_analysis_surfaces_roof_2, Data2=cluster_3.srf_analysis_surfaces_facade_2)
mesh_context = Mesh(mjoin_2)
brep_context_3 = Brep(merge_2)
filter = StreamFilter(
    Gate=num_surface_choice_2,
    Stream0=cluster_3.srf_analysis_surfaces_facade_2,
    Stream1=cluster_3.srf_analysis_surfaces_roof_2,
    Stream2=merge_3)
srf_surfaces_for_analysis = Surface(flatten(filter))
data_weather_file_3 = Data(data_weather_file_2)
srf = Surface(flatten(srf_surfaces_for_analysis))

# ---- group: hourly data
weather = Weather(
    Location=data_weather_file_3,
    Input_0_Hidden=False,
    Input_0_Name="Location",
    Output_0_Hidden=True,
    Output_0_Name="Location",
    Output_10_Hidden=True,
    Output_10_Name="DiffuseHorizontalRadiation",
    Output_11_Hidden=True,
    Output_11_Name="GlobalHorizontalRadiation",
    Output_12_Hidden=True,
    Output_12_Name="SkyCover",
    Output_13_Hidden=True,
    Output_13_Name="Precipitation",
    Output_14_Hidden=False,
    Output_14_Name="Elev",
    Output_15_Hidden=False,
    Output_15_Name="Azimuth",
    Output_16_Hidden=True,
    Output_16_Name="Vector",
    Output_17_Hidden=True,
    Output_17_Name="Illuminance",
    Output_18_Hidden=True,
    Output_18_Name="DateTime",
    Output_19_Hidden=True,
    Output_19_Name="DryBulbAverages",
    Output_1_Hidden=True,
    Output_1_Name="Latitude",
    Output_20_Hidden=True,
    Output_20_Name="DewPointAverages",
    Output_21_Hidden=True,
    Output_21_Name="DryBulbMinima"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)  # -> DirectNormalRadiation, Elev, Azimuth

# ----
# Gets Hours for the 10th and 20th days for every month 6am to 8pm
cluster_4 = Cluster_2()

geo_joined_mesh_context = Geometry(mesh_context)
srf_analysis_surfaces = Surface(graft(srf))
item = ListItem(List=weather.DirectNormalRadiation, Index=cluster_4, Wrap=True)
item_2 = ListItem(List=weather.Elev, Index=cluster_4, Wrap=True)
item_3 = ListItem(List=weather.Azimuth, Index=cluster_4, Wrap=True)
area = Area(Geometry=srf_analysis_surfaces)  # -> Area, Centroid
num_dirnormrad = Number(item)
num_elev = Number(item_2)
num_azi = Number(item_3)
c_script = CSharpScript(Sh=num_elev, Dn=num_dirnormrad)  # -> out, R, Dh; inputs Sh: Double, Dn: Double
# ---------- c_script: C# usings ----------
using System.IO;
using System.Linq;
using System.Data;
using System.Drawing;
using System.Reflection;
using System.Windows.Forms;
using System.Xml;
using System.Xml.Linq;
using System.Runtime.InteropServices;

using Rhino.DocObjects;
using Rhino.Collections;
using GH_IO;
using GH_IO.Serialization;
# ---------- c_script: C# ----------
    double angle = (90 - Sh) * Math.PI / 180;
    double red = Math.Cos(angle);
    R = red;
    Dh = red * Dn;
# ---------- end c_script ----------
num_elev_2 = Number(num_elev)
num_azi_2 = Number(num_azi)
num_dirhorrad = Number(c_script.Dh)

# ---- group: Rays_Sun
cluster_5 = Cluster(raylen="200", D=num_elev_2, D_2=num_azi_2)

# ----
pt = Point(area.Centroid)
neg = Negative(Value=cluster_5)

# ---- group: Solar Exposure
occ = Occlusion(Samples=pt, Obstructions=geo_joined_mesh_context, Rays=neg)  # -> Hits, Occlusion
not = GateNot(A=occ.Occlusion)
bool_is_it_sunny = Boolean(not)

# ---- group: Replace 0 Length Vectors
devec = DeconstructVector(Vector=cluster_5)  # -> XComponent, YComponent, ZComponent
larger = LargerThan(FirstNumber=devec.ZComponent, SecondNumber=0)  # -> LargerThan, OrEqualTo

# ----
multiplication = Multiplication(A=bool_is_it_sunny, B=larger.LargerThan)
int_issunny = Integer(multiplication)
srf_analysis_surfaces_2 = Surface(graft(srf_analysis_surfaces))
int_issunny_2 = Integer(simplify(int_issunny))
num_dirhorrad_2 = Number(num_dirhorrad)
multiplication_2 = Multiplication(A=num_dirhorrad_2, B=int_issunny_2)
int_dirhorrad = Integer(multiplication_2)

# ---- group: a proxy of anual solar radiation
ma = MassAddition(Input=int_dirhorrad)  # -> Result, PartialResults

# ----
bnd = Bounds(Numbers=flatten(ma.Result))
dedomain = DeconstructDomain(Domain=bnd)  # -> Start, End
gradient = Gradient(
    LowerLimit="0",
    UpperLimit=dedomain.End,
    Parameter=ma.Result,
    stops=[0: RGB(0, 110, 128), 0.5: RGB(255, 255, 0), 1: RGB(255, 0, 0)])
mesh_2 = Mesh(srf_analysis_surfaces_2)
mcol = MeshColours(Mesh=simplify(mesh_2), Colours=simplify(gradient))
int_acceptable_pv_effiecency_per_sq_ft_2 = Integer(int_acceptable_pv_effiecency_per_sq_ft)
panel = Panel("3")
hour = Panel("3600000")
brep_massing_to_analyze_3 = Brep(brep_massing_to_analyze_2)
area_2 = Area(Geometry=brep_massing_to_analyze_3)  # -> Area, Centroid
volume = Volume(Geometry=brep_massing_to_analyze_3)  # -> Volume, Centroid
num = Number(ma.Result)
num_2 = Number(dedomain.End)
division = Division(A=area_2.Area, B=volume.Volume)
num_a_proxy_of_annual_solar_radiation = Number(num)
avr = Average(Input=division)
srf_analysis_surfaces_3 = Surface(graft(srf_analysis_surfaces_2))
num_upper_limit = Number(num_2)
num_proxy_of_construction_expexse_buildi = Number(avr)  # "Num : proxy of construction expexse - Building efficiency"
srf_analysis_surfaces_4 = ClusterOutput(srf_analysis_surfaces_3)
proxy_for_construction_expense_building = Panel(avr)  # "Proxy for construction expense -- Building Effiecency"
num_upper_limit_2 = ClusterOutput(num_upper_limit)
num_a_proxy_of_annual_solar_radiation_2 = ClusterOutput(num_a_proxy_of_annual_solar_radiation)
num_proxy_of_construction_expexse_buildi_2 = ClusterOutput(num_proxy_of_construction_expexse_buildi)  # "Num : proxy of construction expexse - Building efficiency"

# ----
# Filter to match PV effieceny threshold
# Note 3: This is taking a % of the upper bounds of the domain. Use this to determine a specific threshold value. In the end you tool should not be basing the threshold off a % of the upper limit of the domain. IE a static threshold not a dynamic one
panel_2 = Panel(".9")
multiplication_3 = Multiplication(A=dedomain.End, B=panel_2)

num_effiency_threshold_proxy = Number(multiplication_3)
effiecency_thresold_proxy = Panel(num_effiency_threshold_proxy)

larger_2 = LargerThan(FirstNumber=ma.Result, SecondNumber=num_effiency_threshold_proxy)  # -> LargerThan, OrEqualTo
cull = CullPattern(List=srf_analysis_surfaces_2, CullPattern=larger_2.OrEqualTo)

# ----
# Note 4: Once you have the surfaces that meet the threshold value, you can then estimate energy production based on their surface area. Useing the per sq ft value referenced in note 1
area_3 = Area(Geometry=flatten(cull))  # -> Area, Centroid
edges = BrepEdges(Brep=cull)  # -> Naked, Interior, NonManifold
ma_2 = MassAddition(Input=area_3.Area)  # -> Result, PartialResults
lng = ListLength(List=flatten(cull))
panel_3 = Panel(lng)
multiplication_4 = Multiplication(A=int_acceptable_pv_effiecency_per_sq_ft_2, B=ma_2.Result)
division_2 = Division(A=multiplication_4, B=hour)
kwh = Panel(division_2)
num_3 = Number(division_2)
num_annual_energy_generation_simulation = Number(num_3)
num_annual_energy_generation_simulation_2 = ClusterOutput(num_annual_energy_generation_simulation)

# ==== cluster Cluster
D = ClusterInput()
raylen = ClusterInput()
larger = LargerThan(FirstNumber=D, SecondNumber=0.01)  # -> LargerThan, OrEqualTo
X = UnitX(Factor=1)
Y = UnitY(Factor=1)
rad = Radians(Degrees=D)
lng = ListLength(List=larger.LargerThan)
vrot = Rotate(Vector=Y, Axis=X, Angle=rad)
D_2 = ClusterInput()
dup = DuplicateData(Data="0", Number=lng, Order=True)
dup_2 = DuplicateData(Data=raylen, Number=lng, Order=True)
rad_2 = Radians(Degrees=D_2)
Z = UnitZ(Factor=1)
vrot_2 = Rotate(Vector=vrot, Axis=Z, Angle=rad_2)
p_n_c = PickNChoose(Pattern=larger.LargerThan, Stream0=dup, Stream1=dup_2)
multiplication = Multiplication(A=p_n_c, B=vrot_2)
R = ClusterOutput(multiplication)

# ==== cluster Cluster_2
series = Series(Start="6", Step=1, Count="20")
series_2 = Series(Start="1", Step=1, Count="12")
panel = Panel("""10
20""")
item = ListItem(List=series, Index=0, Wrap=True)  # -> Item, Item1, Item2, Item3, Item4, Item5, Item6, Item7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
hoy = HourOfYear(Month=graft(series_2), Day=panel, Hour=item.Item14)  # -> flatten(HourOfYear), DayOfYear
hoy_2 = HourOfYear(Month=graft(series_2), Day=panel, Hour=item.Item6)  # -> flatten(HourOfYear), DayOfYear
hoy_3 = HourOfYear(Month=graft(series_2), Day=panel, Hour=item.Item9)  # -> flatten(HourOfYear), DayOfYear
hoy_4 = HourOfYear(Month=graft(series_2), Day=panel, Hour=item.Item8)  # -> flatten(HourOfYear), DayOfYear
hoy_5 = HourOfYear(Month=graft(series_2), Day=panel, Hour=item.Item7)  # -> flatten(HourOfYear), DayOfYear
hoy_6 = HourOfYear(Month=graft(series_2), Day=panel, Hour=item.Item10)  # -> flatten(HourOfYear), DayOfYear
hoy_7 = HourOfYear(Month=graft(series_2), Day=panel, Hour=item.Item)  # -> flatten(HourOfYear), DayOfYear
hoy_8 = HourOfYear(Month=graft(series_2), Day=panel, Hour=item.Item1)  # -> flatten(HourOfYear), DayOfYear
hoy_9 = HourOfYear(Month=graft(series_2), Day=panel, Hour=item.Item4)  # -> flatten(HourOfYear), DayOfYear
hoy_10 = HourOfYear(Month=graft(series_2), Day=panel, Hour=item.Item5)  # -> flatten(HourOfYear), DayOfYear
hoy_11 = HourOfYear(Month=graft(series_2), Day=panel, Hour=item.Item3)  # -> flatten(HourOfYear), DayOfYear
hoy_12 = HourOfYear(Month=graft(series_2), Day=panel, Hour=item.Item13)  # -> flatten(HourOfYear), DayOfYear
hoy_13 = HourOfYear(Month=graft(series_2), Day=panel, Hour=item.Item2)  # -> flatten(HourOfYear), DayOfYear
hoy_14 = HourOfYear(Month=graft(series_2), Day=panel, Hour=item.Item12)  # -> flatten(HourOfYear), DayOfYear
hoy_15 = HourOfYear(Month=graft(series_2), Day=panel, Hour=item.Item11)  # -> flatten(HourOfYear), DayOfYear
merge = Merge(
    Data1=hoy_7.HourOfYear,
    Data2=hoy_8.HourOfYear,
    Data3=hoy_13.HourOfYear,
    Data4=hoy_11.HourOfYear,
    Data5=hoy_9.HourOfYear,
    Data6=hoy_10.HourOfYear,
    Data7=hoy_2.HourOfYear,
    Data8=hoy_5.HourOfYear,
    Data9=hoy_4.HourOfYear,
    Data10=hoy_3.HourOfYear,
    Data11=hoy_6.HourOfYear,
    Data12=hoy_15.HourOfYear,
    Data13=hoy_14.HourOfYear,
    Data14=hoy_12.HourOfYear,
    Data15=hoy.HourOfYear)
sort = SortList(Keys=merge)  # -> Keys, ValuesA
int_hours = Integer(sort.Keys)
int_hours_2 = ClusterOutput(int_hours)

# ==== cluster Cluster_4
num_analysis_resolution = ClusterInput()
brep_design = ClusterInput()
num_analysis_resolution_2 = Number(num_analysis_resolution)
brep_design_2 = Brep(brep_design)
debrep = DeconstructBrep(Brep=brep_design_2)  # -> Faces, Edges, Vertices
dispatch = Dispatch(List=debrep.Faces, DispatchPattern=[True, False])  # -> ListA, ListB
num_analysis_resolution_3 = Number(num_analysis_resolution_2)
evalsrf = EvaluateSurface(Surface=reparameterize(debrep.Faces), Point="{0.5,0.5,0}")  # -> Point, Normal, UDirection, VDirection, Frame
pdecon = Deconstruct(Point=evalsrf.Normal)  # -> XComponent, YComponent, ZComponent
pdecon_2 = Deconstruct(Point=evalsrf.Normal)  # -> XComponent, YComponent, ZComponent
abs = Absolute(Value=pdecon.ZComponent)
smaller = SmallerThan(FirstNumber=abs, SecondNumber="0.95")  # -> SmallerThan, OrEqualTo
larger = LargerThan(FirstNumber=pdecon_2.ZComponent, SecondNumber="0.9")  # -> LargerThan, OrEqualTo
cull = CullPattern(List=debrep.Faces, CullPattern=larger.LargerThan)
cull_2 = CullPattern(List=debrep.Faces, CullPattern=smaller.SmallerThan)
srftrimd = IsSurfaceTrimmed(Surface=cull_2)  # -> flatten(Trimmed)
Z = UnitZ(Factor="0.5")
dispatch_2 = Dispatch(List=cull_2, DispatchPattern=srftrimd)  # -> ListA, ListB
move = Move(Geometry=cull, Motion=Z)  # -> Geometry, Transform
evalsrf_2 = EvaluateSurface(Surface=cull, Point="{0.5,0.5,0}")  # -> Point, Normal, UDirection, VDirection, Frame
srf = Surface(flatten(dispatch_2.ListA))
srf_2 = Surface(flatten(dispatch_2.ListB))
srf_surfaces_to_subdivide = Surface(simplify(graft(srf_2)))
evalsrf_3 = EvaluateSurface(Surface=reparameterize(srf), Point="{0.5,0.5,0}")  # -> Point, Normal, UDirection, VDirection, Frame
num_analysis_resolution_4 = Number(num_analysis_resolution_2)
amp = Amplitude(Vector=evalsrf_2.Normal, Amplitude="0.5")
move_2 = Move(Geometry=cull, Motion=amp)  # -> Geometry, Transform
dim = Dimensions(Surface=srf_surfaces_to_subdivide)  # -> UDimension, VDimension
srf_3 = Surface(move.Geometry)
amp_2 = Amplitude(Vector=evalsrf_3.Normal, Amplitude="1")
srf_surface_for_daylight_analysis = Surface(simplify(graft(srf_3)))
division = Division(A=dim.UDimension, B=num_analysis_resolution_4)
division_2 = Division(A=dim.VDimension, B=num_analysis_resolution_4)
move_3 = Move(Geometry=srf, Motion=amp_2)  # -> Geometry, Transform
dim_2 = Dimensions(Surface=srf_surface_for_daylight_analysis)  # -> UDimension, VDimension
max = Maximum(A=division, B="1")
max_2 = Maximum(A=division_2, B="1")
srf_analysis_srf = Surface(move_3.Geometry)
division_3 = Division(A=dim_2.UDimension, B=num_analysis_resolution_3)
division_4 = Division(A=dim_2.VDimension, B=num_analysis_resolution_3)
divide = DivideDomain²(Domain=srf_surfaces_to_subdivide, UCount=max, VCount=max_2)
divide_2 = DivideDomain²(Domain=srf_surface_for_daylight_analysis, UCount=division_3, VCount=division_4)
subsrf = Isotrim(Surface=srf_surfaces_to_subdivide, Domain=divide)
cluster = Cluster_3(srf=srf_analysis_srf, num_sub_division_size=num_analysis_resolution_3)  # -> simplify(srf_subdivide_srf_2)
subsrf_2 = Isotrim(Surface=srf_surface_for_daylight_analysis, Domain=divide_2)
bbx = BrepBrep(BrepA=srf_surface_for_daylight_analysis, BrepB=subsrf_2)  # -> Curves, Points
evalsrf_4 = EvaluateSurface(Surface=reparameterize(subsrf), Point="{0.5,0.5,0}")  # -> Point, Normal, UDirection, VDirection, Frame
crv = Curve(flatten(bbx.Curves))
cls = Closed(Curve=crv)  # -> Closed, Periodic
amp_3 = Amplitude(Vector=evalsrf_4.Normal, Amplitude="1")
dispatch_3 = Dispatch(List=crv, DispatchPattern=cls.Closed)  # -> ListA, ListB
move_4 = Move(Geometry=subsrf, Motion=amp_3)  # -> Geometry, Transform
srf_4 = Surface(flatten(move_4.Geometry))

evalsrf_5 = EvaluateSurface(Surface=reparameterize(dispatch_3.ListA), Point="{0.5,0.5,0}")  # -> Point, Normal, UDirection, VDirection, Frame
vdis = VectorDisplay(Anchor=evalsrf_5.Point, Vector=evalsrf_5.Normal)

pdecon_3 = Deconstruct(Point=evalsrf_5.Normal)  # -> XComponent, YComponent, ZComponent
larger_2 = LargerThan(FirstNumber=pdecon_3.ZComponent, SecondNumber=Slider(0.5, range=0..1))  # -> LargerThan, OrEqualTo
dispatch_4 = Dispatch(List=dispatch_3.ListA, DispatchPattern=larger_2.LargerThan)  # -> ListA, ListB
flip = Flip(Surface=dispatch_4.ListB)  # -> Surface, Result
merge = Merge(Data1=dispatch_4.ListA, Data2=flip.Surface)
srf_5 = Surface(flatten(merge))
srf_6 = Surface(flatten(cluster))
merge_2 = Merge(Data1=srf_6, Data2=srf_4)
srf_analysis_surfaces_facade = Surface(merge_2)
srf_analysis_surfaces_roof = Surface(srf_5)
srf_analysis_surfaces_facade_2 = ClusterOutput(srf_analysis_surfaces_facade)
srf_analysis_surfaces_roof_2 = ClusterOutput(srf_analysis_surfaces_roof)

# ==== cluster Cluster_5
folder_path = ClusterInput()

# ----
# Note 0: Full exposed panel (20' *20') to establish baseline for effiecency calcualtion
srf_analysis_surfaces = Surface(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)

folder_path_2 = Data(folder_path)
pv = TakesSurfacesGeneratesPVPanels(BrepSurfaces=srf_analysis_surfaces, EfficiencyFraction="0.17", EffectiveAreaFraction="0.8")
epw = ClusterInput()
run = ClusterInput()
pv_2 = RunsAPVSimulation(
    PVPanels=pv,
    ProjectName="norm",
    WorkingDirectory=folder_path_2,
    WeatherFile=epw,
    StartsTheSimulation=run,
    settings="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")  # -> Model, CSV
load_csv = LoadResultFile(Model=pv_2.Model, Normalize=False, Toggle=Toggle(True))  # -> graft(PanelGeometry), PanelCentroid, Results, Labels
ma = MassAddition(Input=load_csv.Results)  # -> Result, PartialResults
ma_2 = MassAddition(Input=flatten(ma.Result))  # -> Result, PartialResults
num_energy_generated = Number(ma_2.Result)
acceptable_effiecent = Panel(".85")
fully_exposed_panel_sq_ft = Panel("400")
acceptable_effiecent_2 = Panel(".85")

# ----
# Internalized Fully Exposed PV for a 20' x 20' panel
# Note 1: Since this will change based on the size of the panel, you will need to convert this value to a per sq foot number so that you can calculate total energy production based on the surface area of the panels that meet the threshold from the proxy at the end
num_energy_generated_2 = Number(num_energy_generated)
hour = Panel("3600000")

# ---- group: a year
total_energy_generated_in_joules = Panel(num_energy_generated_2)

# ----
multiplication = Multiplication(A=total_energy_generated_in_joules, B=acceptable_effiecent)

division = Division(A=total_energy_generated_in_joules, B=hour)
kwh = Panel(division)

multiplication_2 = Multiplication(A=total_energy_generated_in_joules, B=acceptable_effiecent_2)
division_2 = Division(A=multiplication, B=fully_exposed_panel_sq_ft)
acceptable_pv_effiecency = Panel(multiplication_2)
acceptable_pv_effiecency_per_sq_ft = Panel(division_2)
int_acceptable_pv_effiecency_per_sq_ft = Integer(division_2)
int_acceptable_pv_effiecency_per_sq_ft_2 = ClusterOutput(int_acceptable_pv_effiecency_per_sq_ft)

# ==== cluster Cluster_6
num_analysis_resolution = ClusterInput()
brep_design = ClusterInput()
num_analysis_resolution_2 = Number(num_analysis_resolution)
brep_design_2 = Brep(brep_design)
debrep = DeconstructBrep(Brep=brep_design_2)  # -> Faces, Edges, Vertices
srf = Surface(flatten(debrep.Faces))
num_analysis_resolution_3 = Number(num_analysis_resolution_2)
evalsrf = EvaluateSurface(Surface=reparameterize(srf), Point="{0.5,0.5,0}")  # -> Point, Normal, UDirection, VDirection, Frame
pdecon = Deconstruct(Point=evalsrf.Normal)  # -> XComponent, YComponent, ZComponent
abs = Absolute(Value=pdecon.ZComponent)
pdecon_2 = Deconstruct(Point=evalsrf.Normal)  # -> XComponent, YComponent, ZComponent
smaller = SmallerThan(FirstNumber=abs, SecondNumber="0.95")  # -> SmallerThan, OrEqualTo
cull = CullPattern(List=debrep.Faces, CullPattern=smaller.SmallerThan)
larger = LargerThan(FirstNumber=pdecon_2.ZComponent, SecondNumber="0.9")  # -> LargerThan, OrEqualTo
srf_2 = Surface(flatten(cull))
srftrimd = IsSurfaceTrimmed(Surface=srf_2)  # -> flatten(Trimmed)
cull_2 = CullPattern(List=debrep.Faces, CullPattern=larger.LargerThan)
dispatch = Dispatch(List=srf_2, DispatchPattern=srftrimd)  # -> ListA, ListB
srf_3 = Surface(flatten(dispatch.ListA))
srf_4 = Surface(flatten(dispatch.ListB))
evalsrf_2 = EvaluateSurface(Surface=cull_2, Point="{0.5,0.5,0}")  # -> Point, Normal, UDirection, VDirection, Frame
Z = UnitZ(Factor="0.5")
evalsrf_3 = EvaluateSurface(Surface=reparameterize(srf_3), Point="{0.5,0.5,0}")  # -> Point, Normal, UDirection, VDirection, Frame
srf_surfaces_to_subdivide = Surface(simplify(graft(srf_4)))
move = Move(Geometry=cull_2, Motion=Z)  # -> Geometry, Transform
num_analysis_resolution_4 = Number(num_analysis_resolution_2)
amp = Amplitude(Vector=evalsrf_2.Normal, Amplitude="0.5")
move_2 = Move(Geometry=cull_2, Motion=amp)  # -> Geometry, Transform
dim = Dimensions(Surface=srf_surfaces_to_subdivide)  # -> UDimension, VDimension
amp_2 = Amplitude(Vector=evalsrf_3.Normal, Amplitude="1")
srf_5 = Surface(move_2.Geometry)
move_3 = Move(Geometry=srf_3, Motion=amp_2)  # -> Geometry, Transform
division = Division(A=dim.UDimension, B=num_analysis_resolution_4)
division_2 = Division(A=dim.VDimension, B=num_analysis_resolution_4)
srf_surface_for_daylight_analysis = Surface(simplify(graft(srf_5)))
max = Maximum(A=division, B="1")
max_2 = Maximum(A=division_2, B="1")
srf_analysis_srf = Surface(move_3.Geometry)
divide = DivideDomain²(Domain=srf_surfaces_to_subdivide, UCount=max, VCount=max_2)
cluster = Cluster_3(srf=srf_analysis_srf, num_sub_division_size=num_analysis_resolution_3)  # -> simplify(srf_subdivide_srf_2)
subsrf = Isotrim(Surface=srf_surfaces_to_subdivide, Domain=divide)
dim_2 = Dimensions(Surface=srf_surface_for_daylight_analysis)  # -> UDimension, VDimension
division_3 = Division(A=dim_2.UDimension, B=num_analysis_resolution_3)
division_4 = Division(A=dim_2.VDimension, B=num_analysis_resolution_3)
evalsrf_4 = EvaluateSurface(Surface=reparameterize(subsrf), Point="{0.5,0.5,0}")  # -> Point, Normal, UDirection, VDirection, Frame
divide_2 = DivideDomain²(Domain=srf_surface_for_daylight_analysis, UCount=division_3, VCount=division_4)
srf_6 = Surface(flatten(cluster))
subsrf_2 = Isotrim(Surface=srf_surface_for_daylight_analysis, Domain=divide_2)
amp_3 = Amplitude(Vector=evalsrf_4.Normal, Amplitude="1")
bbx = BrepBrep(BrepA=srf_surface_for_daylight_analysis, BrepB=subsrf_2)  # -> Curves, Points
move_4 = Move(Geometry=subsrf, Motion=amp_3)  # -> Geometry, Transform
crv = Curve(flatten(bbx.Curves))
srf_7 = Surface(flatten(move_4.Geometry))
merge = Merge(Data1=srf_6, Data2=srf_7)
cls = Closed(Curve=crv)  # -> Closed, Periodic
dispatch_2 = Dispatch(List=crv, DispatchPattern=cls.Closed)  # -> ListA, ListB

evalsrf_5 = EvaluateSurface(Surface=reparameterize(dispatch_2.ListA), Point="{0.5,0.5,0}")  # -> Point, Normal, UDirection, VDirection, Frame
vdis = VectorDisplay(Anchor=evalsrf_5.Point, Vector=evalsrf_5.Normal)

pdecon_3 = Deconstruct(Point=evalsrf_5.Normal)  # -> XComponent, YComponent, ZComponent
larger_2 = LargerThan(FirstNumber=pdecon_3.ZComponent, SecondNumber=Slider(0.5, range=0..1))  # -> LargerThan, OrEqualTo
dispatch_3 = Dispatch(List=dispatch_2.ListA, DispatchPattern=larger_2.LargerThan)  # -> ListA, ListB
srf_analysis_surfaces_facade = Surface(merge)
flip = Flip(Surface=dispatch_3.ListB)  # -> Surface, Result
merge_2 = Merge(Data1=dispatch_3.ListA, Data2=flip.Surface)
srf_analysis_surfaces_facade_2 = ClusterOutput(srf_analysis_surfaces_facade)
srf_8 = Surface(flatten(merge_2))
srf_analysis_surfaces_roof = Surface(srf_8)
srf_analysis_surfaces_roof_2 = ClusterOutput(srf_analysis_surfaces_roof)

# ==== cluster Cluster_3
num_sub_division_size = ClusterInput()
srf = ClusterInput()
num_sub_division_size_2 = Number(num_sub_division_size)
srf_2 = Surface(srf)
bbox = BoundingBox(Content=srf_2, Plane=PlaneXY(0, 0, 0), UnionBox=True)  # -> Box, Box_2
num_sub_division_size_3 = Number(num_sub_division_size_2)
debrep = DeconstructBrep(Brep=bbox.Box)  # -> Faces, Edges, Vertices
item = ListItem(List=debrep.Faces, Index=0, Wrap=True)  # -> Item, Item1, Item2, Item3, Item4, Item5
area = Area(Geometry=item.Item5)  # -> Area, Centroid
area_2 = Area(Geometry=item.Item4)  # -> Area, Centroid
ln = Line(StartPoint=area_2.Centroid, EndPoint=area.Centroid)
len = Length(Curve=ln)
division = Division(A=len, B=num_sub_division_size_2)
pframes = PerpFrames(Curve=ln, Count=division, Align=True)  # -> Frames, Parameters
srf_3 = Surface(graft(srf_2))
sec = BrepPlane(Brep=graft(srf_2), Plane=pframes.Frames)  # -> simplify(Curves), Points
path_mapper = PathMapper(sec.Curves, source="{A;B;C}", target="{A;B}")
srfsplit = SurfaceSplit(Surface=srf_3, Curves=path_mapper)  # -> simplify(graft(Fragments))
num_sub_division_size_4 = Number(num_sub_division_size_3)
debrep_2 = DeconstructBrep(Brep=srfsplit)  # -> Faces, Edges, Vertices
len_2 = Length(Curve=debrep_2.Edges)
sort = SortList(Keys=len_2, ValuesA=debrep_2.Edges)  # -> reverse(Keys), reverse(ValuesA)
item_2 = ListItem(List=sort.Keys, Index=0, Wrap=True)
item_3 = ListItem(List=sort.ValuesA, Index=0, Wrap=True)
division_2 = Division(A=item_2, B=num_sub_division_size_4)
pframes_2 = PerpFrames(Curve=item_3, Count=division_2, Align=True)  # -> Frames, Parameters
sec_2 = BrepPlane(Brep=graft(srfsplit), Plane=pframes_2.Frames)  # -> simplify(Curves), Points
path_mapper_2 = PathMapper(sec_2.Curves, source="{A;B;C;D}", target="{A;B;C}")
srfsplit_2 = SurfaceSplit(Surface=srfsplit, Curves=path_mapper_2)
srf_subdivide_srf = Surface(srfsplit_2)
srf_subdivide_srf_2 = ClusterOutput(srf_subdivide_srf)
