# Grasshopper definition Wind_Analysis.gh (Grasshopper 1.0.7)
# plug-ins: Pufferfish, Human

crv_wind_lines = Curve(Tree({0;0;0;0;0;0}: [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], {0;0;0;0;0;0;0;0}: [], {0;0;0;0;0;0;0;1}: [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], {0;0;0;0;0;0;0;2}: [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], {0;0;0;0;0;0;0;3}: [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], {0;0;1;0;0;0}: [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]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))
crv_north = Curve(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)
crv_streets = Curve(Tree({0}: [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], {1}: [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], {2}: [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], {3}: [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], {4}: [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], {5}: [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], {6}: [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]))
crv_north_2 = Curve(crv_north)
crv_streets_2 = Curve(crv_streets)
crv_secondary_wind_channels = Curve(crv_wind_lines)
end = EndPoints(Curve=crv_streets_2)  # -> Start, End
ln = Line(StartPoint=end.Start, EndPoint=end.End)
angle = Angle(VectorA=ln, VectorB=crv_north_2)  # -> Angle, Reflex
deg = Degrees(Radians=angle.Angle)

larger = LargerThan(FirstNumber=deg, SecondNumber="90")  # -> LargerThan, OrEqualTo
dispatch = Dispatch(List=deg, DispatchPattern=larger.LargerThan)  # -> ListA, ListB
subtraction = Subtraction(A="180", B=dispatch.ListA)
equals = Equality(FirstNumber=subtraction, SecondNumber="180")  # -> Equality, Inequality
dispatch_2 = Dispatch(List=subtraction, DispatchPattern=equals.Inequality)  # -> ListA, ListB

merge = Merge(Data1=flatten(crv_secondary_wind_channels))
crv_north_3 = Curve(<curve referenced from the Rhino model>)
angle_2 = Angle(VectorA=merge, VectorB=crv_north_3)  # -> Angle, Reflex
deg_2 = Degrees(Radians=angle_2.Angle)
larger_2 = LargerThan(FirstNumber=deg_2, SecondNumber="90")  # -> LargerThan, OrEqualTo
dispatch_3 = Dispatch(List=deg_2, DispatchPattern=larger_2.LargerThan)  # -> ListA, ListB
num = Number(dispatch_3.ListA)
subtraction_2 = Subtraction(A="180", B=num)
merge_2 = Merge(Data1=subtraction_2, Data2=dispatch_3.ListB)
bnd = Bounds(Numbers=flatten(merge_2))
remap = RemapNumbers(Value=merge_2, Source=bnd, Target="0 to 100")  # -> Mapped, Clipped
avr = Average(Input=remap.Mapped)
secondary_street_airflow_reduction = Panel(avr)

smaller = SmallerThan(FirstNumber=deg, SecondNumber="90")  # -> SmallerThan, OrEqualTo
crv_streets_3 = Curve(crv_streets_2)

merge_3 = Merge(Data1=flatten(crv_streets_2))
crv_north_4 = Curve(<curve referenced from the Rhino model>)
angle_3 = Angle(VectorA=merge_3, VectorB=crv_north_4)  # -> Angle, Reflex
deg_3 = Degrees(Radians=angle_3.Angle)
larger_3 = LargerThan(FirstNumber=deg_3, SecondNumber="90")  # -> LargerThan, OrEqualTo
dispatch_4 = Dispatch(List=deg_3, DispatchPattern=larger_3.LargerThan)  # -> ListA, ListB
num_2 = Number(dispatch_4.ListA)
subtraction_3 = Subtraction(A="180", B=num_2)
merge_4 = Merge(Data1=subtraction_3, Data2=dispatch_4.ListB)
bnd_2 = Bounds(Numbers=flatten(merge_4))
remap_2 = RemapNumbers(Value=merge_4, Source=bnd_2, Target="0 to 100")  # -> Mapped, Clipped
avr_2 = Average(Input=remap_2.Mapped)
average_airflow_reduction = Panel(avr_2)

dispatch_5 = Dispatch(List=deg, DispatchPattern=smaller.SmallerThan)  # -> ListA, ListB
crv = Curve(crv_secondary_wind_channels)
end_2 = EndPoints(Curve=crv)  # -> Start, End
ln_2 = Line(StartPoint=end_2.Start, EndPoint=end_2.End)
crv_north_5 = Curve(<curve referenced from the Rhino model>)
merge_5 = Merge(Data1=dispatch_5.ListA, Data2=dispatch_2.ListA)
angle_4 = Angle(VectorA=ln_2, VectorB=crv_north_5)  # -> Angle, Reflex
deg_4 = Degrees(Radians=angle_4.Angle)

larger_4 = LargerThan(FirstNumber=deg_4, SecondNumber="90")  # -> LargerThan, OrEqualTo
dispatch_6 = Dispatch(List=deg_4, DispatchPattern=larger_4.LargerThan)  # -> ListA, ListB
subtraction_4 = Subtraction(A="180", B=dispatch_6.ListA)
equals_2 = Equality(FirstNumber=subtraction_4, SecondNumber="180")  # -> Equality, Inequality
dispatch_7 = Dispatch(List=subtraction_4, DispatchPattern=equals_2.Inequality)  # -> ListA, ListB

bnd_3 = Bounds(Numbers=flatten(merge_5))
smaller_2 = SmallerThan(FirstNumber=deg_4, SecondNumber="90")  # -> SmallerThan, OrEqualTo
offset = OffsetCurve(Curve=crv_streets_3, Distance="20", Plane=PlaneXY(0, 0, 0), Corners=1)
offset_2 = OffsetCurve(Curve=crv_streets_3, Distance="-20", Plane=PlaneXY(0, 0, 0), Corners=1)
remap_3 = RemapNumbers(Value=merge_5, Source=bnd_3, Target="0 to 10")  # -> Mapped, Clipped
dispatch_8 = Dispatch(List=deg_4, DispatchPattern=smaller_2.SmallerThan)  # -> ListA, ListB
loft = Loft(
    Curves=[offset, offset_2],
    Options={Adjust=False, Closed=False, LoftEnds=0, LoftSimp=0, LoftType=0, Rebuild=10, Refit=0.01})
offset_3 = OffsetCurve(Curve=crv_secondary_wind_channels, Distance="-10", Plane=PlaneXY(0, 0, 0), Corners=1)
offset_4 = OffsetCurve(Curve=crv_secondary_wind_channels, Distance="10", Plane=PlaneXY(0, 0, 0), Corners=1)
Z = UnitZ(Factor="100")
merge_6 = Merge(Data1=dispatch_8.ListA, Data2=dispatch_7.ListA)
bnd_4 = Bounds(Numbers=flatten(merge_6))
extr = Extrude(Base=loft, Direction=Z)
loft_2 = Loft(
    Curves=[offset_4, offset_3],
    Options={Adjust=False, Closed=False, LoftEnds=0, LoftSimp=0, LoftType=0, Rebuild=10, Refit=0.01})
remap_4 = RemapNumbers(Value=merge_6, Source=bnd_4, Target="0 to 10")  # -> Mapped, Clipped
gradient = Gradient(
    LowerLimit="0",
    UpperLimit="10",
    Parameter=remap_3.Mapped,
    stops=[0: RGB(58, 84, 164), 0.25: RGB(69, 134, 198), 0.5: RGB(61, 184, 234), 0.75: RGB(122, 200, 169), 1: RGB(217, 224, 40)])
primary_mesh_values = Panel(remap_3.Mapped)
Z_2 = UnitZ(Factor="70")
gradient_2 = Gradient(
    LowerLimit="0",
    UpperLimit="10",
    Parameter=remap_4.Mapped,
    stops=[0: RGB(58, 84, 164), 0.25: RGB(69, 134, 198), 0.5: RGB(61, 184, 234), 0.75: RGB(122, 200, 169), 1: RGB(217, 224, 40)])
secondary_mesh_values = Panel(remap_4.Mapped)
extr_2 = Extrude(Base=loft_2, Direction=Z_2)
previewlw = CustomPreviewLineweights(Geometry=extr, Shader=gradient, Absolute=False)
previewlw_2 = CustomPreviewLineweights(Geometry=extr_2, Shader=gradient_2, Absolute=False)
roundd = RoundToDecimalPlace(NumberX=secondary_street_airflow_reduction, DecimalPlace="1", RoundType=0)  # -> Rounded, Difference
roundd_2 = RoundToDecimalPlace(NumberX=average_airflow_reduction, DecimalPlace="1", RoundType=0)  # -> Rounded, Difference
geo_secondary_streets = Geometry(extr_2)
num_primary_airflow = Number(roundd_2.Rounded)
geo_primary_street = Geometry(extr)
num_secondary_airflow = Number(roundd.Rounded)
